# Grasshopper definition XHG.⚪ᔓᔕ⚪ᗱᗴ⚪ᙁ⚪ᑐᑕ⚪ᴥ⚪ꖴ⚪ᑐᑕ⚪◯⚪✤⚪ИN⚪ᗱᗴ⚪ᕤᕦ⚪ИN⚪ᗩ⚪✤⚪◯⚪ᙁ⚪ᗩ⚪ꖴ⚪ᗝ⚪ᗩ⚪ᴥ⚪◌⚪◌⚪◌⚪◌⚪◌⚪◌⚪ᴥ⚪ᗩ⚪ᗝ⚪ꖴ⚪ᗩ⚪ᙁ⚪◯⚪✤⚪ᗩ⚪ИN⚪ᕤᕦ⚪ᗱᗴ⚪ИN⚪✤⚪◯⚪ᑐᑕ⚪ꖴ⚪ᴥ⚪ᑐᑕ⚪ᙁ⚪ᗱᗴ⚪ᔓᔕ⚪.GHX (Grasshopper 1.0.7)
# plug-ins: CurvePlus

polyline = PolyLine(Closed=False)
digit_scroller = DigitScroller(Scroller_Digits=12, Scroller_Prefix=" ", Scroller_Radix=11, Scroller_Value=16)
digit_scroller_2 = DigitScroller(Scroller_Digits=12, Scroller_Prefix=" ", Scroller_Radix=11, Scroller_Value=16)
subtraction = Subtraction(A=digit_scroller, B=1)
subtraction_2 = Subtraction(A=digit_scroller_2, B=2)
expression = Expression(O=subtraction_2, Expression="tan((π*O)/(4*(O+2)))^-2")
format = Format(Format="{0:R}", Culture=127, Data0=expression)  # -> flatten(Text)
panel = Panel(format)
series = Series(Start=1, Step=1, Count=subtraction)
power = Power(A=panel, B=series)
one_over_x = OneOverX(Value=power)
circle = Circle(Plane=PlaneXY(0, 0, 0), Radius=0.5)
circumscribed_polygon = CircumscribedPolygon(Plane=PlaneXY(0, 0, 0), Radius=0.5, Sides=digit_scroller_2)
explode = Explode(Curve=circumscribed_polygon, Recursive=True)  # -> Segments, Vertices
cull_duplicates = CullDuplicates(Points=explode.Vertices, Tolerance=1.164153218e-10, CullMode=1)  # -> Points, Indices, Valence

list_item = ListItem(List=explode.Segments, Index=-1, Wrap=True)
length = Length(Curve=flatten(list_item))  # -> flatten(Length)
format_2 = Format(Format="{0:R}", Culture=127, Data0=length)
panel_2 = Panel(format_2)

list_item_2 = ListItem(List=cull_duplicates.Points, Index=[-1, 0], Wrap=True)
curve_middle = CurveMiddle(Curve=list_item)
line = Line(StartPoint=Point(0, 0, 0), EndPoint=list_item_2)
length_2 = Length(Curve=line)
expression_2 = Expression(O=length, Expression="(SQRT(2)-O)/2")
format_3 = Format(Format="{0:R}", Culture=127, Data0=expression_2)
panel_3 = Panel(format_3)
explode_tree = ExplodeTree(Data=graft(line))  # -> _0000, _0001
circle_tantantan = CircleTanTanTan(CurveA=explode_tree._0000, CurveB=explode_tree._0001, CurveC=list_item, Point=curve_middle)
scale = Scale(Geometry=circle_tantantan, Center=Point(0, 0, 0), Factor=one_over_x)  # -> Geometry, Transform
merge = Merge(Data1=circle_tantantan, Data2=scale.Geometry)
polar_array = PolarArray(Geometry=merge, Plane=PlaneXY(0, 0, 0), Count=digit_scroller_2, Angle=6.283185307)  # -> Geometry, Transform
greyville_points = GreyvillePoints(Curve=polar_array.Geometry)  # -> Points, Parameters
deconstruct = Deconstruct(Point=greyville_points.Points)  # -> XComponent, YComponent, ZComponent

# ---- group: X
expression_3 = Expression(
    U=deconstruct.XComponent,
    V=deconstruct.YComponent,
    Expression="1/2*sqrt(2+pow(u,2)-pow(v,2)+2*sqrt(2)*u)-1/2*sqrt(2+pow(u,2)-pow(v,2)-2*sqrt(2)*u)")

# ---- group: Y
expression_4 = Expression(
    U=deconstruct.XComponent,
    V=deconstruct.YComponent,
    Expression="1/2*sqrt(2-pow(u,2)+pow(v,2)+2*sqrt(2)*v)-1/2*sqrt(2-pow(u,2)+pow(v,2)-2*sqrt(2)*v)")

# ----
construct_point = ConstructPoint(XCoordinate=expression_3, YCoordinate=expression_4, ZCoordinate=0)
interpolate = Interpolate(Vertices=construct_point, Degree=3, Periodic=False, KnotStyle=2)  # -> flatten(Curve), Length, Domain
bounding_box = BoundingBox(Content=interpolate.Curve, Plane=PlaneXY(0, 0, 0), UnionBox=True)  # -> Box, Box_2
deconstruct_box = DeconstructBox(Box=bounding_box.Box)  # -> Plane, X, Y, Z
length_3 = Length(Curve=circle_tantantan)
expression_5 = Expression(O=length_3, Expression="O/(8*ATAN(1))")
format_4 = Format(Format="{0:R}", Culture=127, Data0=expression_5)
panel_4 = Panel(format_4)
curve_closest_point = CurveClosestPoint(Point=Point(0, 0, 0), Curve=circle_tantantan)  # -> Point, Parameter, Distance
line_2 = Line(StartPoint=curve_closest_point.Point, EndPoint=curve_middle)
rotate = Rotate(Vector=line_2, Axis=Vector(0, 0, 1), Angle=degrees([90, -90]))
line_sdl = LineSDL(Start=curve_closest_point.Point, Direction=rotate, Length=curve_closest_point.Distance)
join_curves = JoinCurves(Curves=line_sdl, Preserve=False)
extend_curve = ExtendCurve(Curve=join_curves, Type=0, Start=curve_closest_point.Distance, End=curve_closest_point.Distance)
merge_2 = Merge(Data1=flatten(extend_curve), Data2=flatten(line))
divide_curves_on_intersects = DivideCurvesOnIntersects(Curves=merge_2, Tolerance=1.164153218e-10)

list_item_3 = ListItem(List=divide_curves_on_intersects, Index=8, Wrap=True)
length_4 = Length(Curve=list_item_3)
format_5 = Format(Format="{0:R}", Culture=127, Data0=length_4)
panel_5 = Panel(format_5)

division = Division(A=flatten(length), B=flatten(length_4))
format_6 = Format(Format="{0:R}", Culture=127, Data0=division)  # -> flatten(Text)
panel_6 = Panel(format_6)

division_2 = Division(A=flatten(length_4), B=flatten(length))
end_points = EndPoints(Curve=list_item_3)  # -> Start, End
explode_tree_2 = ExplodeTree(Data=graft(list_item_2))  # -> _0000, _0001
line_3 = Line(StartPoint=end_points.Start, EndPoint=explode_tree_2._0001)
angle = Angle(VectorA=list_item, VectorB=line_3)  # -> expr("DEG(X)", Angle), Reflex
panel_7 = Panel(angle.Angle)
multiplication = Multiplication(A=angle.Angle, B=2)
subtraction_3 = Subtraction(A="180", B=multiplication)
panel_8 = Panel(subtraction_3)
line_4 = Line(StartPoint=end_points.End, EndPoint=explode_tree_2._0001)
line_5 = Line(StartPoint=end_points.Start, EndPoint=explode_tree_2._0000)
line_6 = Line(StartPoint=end_points.End, EndPoint=explode_tree_2._0000)
merge_3 = Merge(Data1=list_item, Data2=line_6, Data3=line_3, Data4=list_item_3)  # -> flatten(Result)
join_curves_2 = JoinCurves(Curves=merge_3, Preserve=False)
scale_2 = Scale(Geometry=join_curves_2, Center=Point(0, 0, 0), Factor=one_over_x)  # -> Geometry, Transform
merge_4 = Merge(Data1=join_curves_2, Data2=scale_2.Geometry)
polar_array_2 = PolarArray(Geometry=merge_4, Plane=PlaneXY(0, 0, 0), Count=digit_scroller_2, Angle=6.283185307)  # -> Geometry, Transform
discontinuity = Discontinuity(Curve=polar_array_2.Geometry, Level=1)  # -> Points, Parameters
deconstruct_2 = Deconstruct(Point=discontinuity.Points)  # -> XComponent, YComponent, ZComponent

# ---- group: Y
expression_6 = Expression(
    U=deconstruct_2.XComponent,
    V=deconstruct_2.YComponent,
    Expression="1/2*sqrt(2-pow(u,2)+pow(v,2)+2*sqrt(2)*v)-1/2*sqrt(2-pow(u,2)+pow(v,2)-2*sqrt(2)*v)")

# ---- group: X
expression_7 = Expression(
    U=deconstruct_2.XComponent,
    V=deconstruct_2.YComponent,
    Expression="1/2*sqrt(2+pow(u,2)-pow(v,2)+2*sqrt(2)*u)-1/2*sqrt(2+pow(u,2)-pow(v,2)-2*sqrt(2)*u)")

# ----
construct_point_2 = ConstructPoint(XCoordinate=expression_7, YCoordinate=expression_6, ZCoordinate=0)
interpolate_2 = Interpolate(Vertices=construct_point_2, Degree=1, Periodic=False, KnotStyle=2)  # -> flatten(Curve), Length, Domain
length_5 = Length(Curve=line_6)
format_7 = Format(Format="{0:R}", Culture=127, Data0=length_5)
panel_9 = Panel(format_7)
length_6 = Length(Curve=list_item)
expression_8 = Expression(O=length_6, Expression="SQRT(3)/(O+SQRT(2))")
format_8 = Format(Format="{0:R}", Culture=127, Data0=expression_8)
panel_10 = Panel(format_8)
length_7 = Length(Curve=line_4)
format_9 = Format(Format="{0:R}", Culture=127, Data0=length_7)
panel_11 = Panel(format_9)
