# Grasshopper definition XHG.⠀⠀⠀⠀ⵙ⠀ᗱᗴ⠀ⵙ⠀ᴥ⠀ⵙ⠀ᗱᗴ⠀ⵙ⠀옷⠀ⵙ⠀ߦ⠀ⵙ⠀ᔓᔕ⠀ⵙ⠀⠀◯⠀⠀ⵙ⠀ИN⠀ⵙ⠀Ⓞ⠀ⵙ⠀⠀◯⠀⠀ⵙ⠀ИN⠀ⵙ⠀Ⓞ⠀ⵙ⠀ꖴ⠀ⵙ⠀✤⠀ⵙ⠀ᑐᑕ⠀ⵙ⠀ᗱᗴ⠀ⵙ⠀ᒍᒐ⠀ⵙ⠀Ⓞ⠀ⵙ⠀ᴥ⠀ⵙ⠀ߦ⠀ⵙ⠀⠀⠀⠀◯⠀⠀⠀⠀ⵙ⠀⠀⠀⠀◯⠀⠀⠀⠀ⵙ⠀ߦ⠀ⵙ⠀ᴥ⠀ⵙ⠀Ⓞ⠀ⵙ⠀ᒍᒐ⠀ⵙ⠀ᗱᗴ⠀ⵙ⠀ᑐᑕ⠀ⵙ⠀✤⠀ⵙ⠀ꖴ⠀ⵙ⠀Ⓞ⠀ⵙ⠀ИN⠀ⵙ⠀⠀◯⠀⠀ⵙ⠀Ⓞ⠀ⵙ⠀ИN⠀ⵙ⠀⠀◯⠀⠀ⵙ⠀ᔓᔕ⠀ⵙ⠀ߦ⠀ⵙ⠀옷⠀ⵙ⠀ᗱᗴ⠀ⵙ⠀ᴥ⠀ⵙ⠀ᗱᗴ⠀ⵙ⠀⠀⠀⠀.GHX (Grasshopper 1.0.7)
# plug-ins: Heteroptera, Pufferfish, BullAnt

digit_scroller = DigitScroller(Scroller_Digits=12, Scroller_Prefix="Digit Scroller", Scroller_Radix=1, Scroller_Value=0.007)
digit_scroller_2 = DigitScroller(Scroller_Digits=12, Scroller_Prefix="Digit Scroller", Scroller_Radix=1, Scroller_Value=0.005)
digit_scroller_3 = DigitScroller(Scroller_Digits=12, Scroller_Prefix="Digit Scroller", Scroller_Radix=1, Scroller_Value=0.001)
digit_scroller_4 = DigitScroller(Scroller_Digits=12, Scroller_Prefix="Digit Scroller", Scroller_Radix=1, Scroller_Value=1)
digit_scroller_5 = DigitScroller(Scroller_Digits=12, Scroller_Prefix="Digit Scroller", Scroller_Radix=1, Scroller_Value=0.16388)
digit_scroller_6 = DigitScroller(Scroller_Digits=12, Scroller_Prefix="Digit Scroller", Scroller_Radix=1, Scroller_Value=0.02398)
digit_scroller_7 = DigitScroller(Scroller_Digits=12, Scroller_Prefix="Digit Scroller", Scroller_Radix=1, Scroller_Value=0.006)
digit_scroller_8 = DigitScroller(Scroller_Digits=12, Scroller_Prefix="Digit Scroller", Scroller_Radix=1, Scroller_Value=0.004)
digit_scroller_9 = DigitScroller(Scroller_Digits=12, Scroller_Prefix="Digit Scroller", Scroller_Radix=1, Scroller_Value=0.003)
digit_scroller_10 = DigitScroller(Scroller_Digits=12, Scroller_Prefix="Digit Scroller", Scroller_Radix=1, Scroller_Value=0.002)
digit_scroller_11 = DigitScroller(Scroller_Digits=12, Scroller_Prefix="Digit Scroller", Scroller_Radix=1, Scroller_Value=0)
merge = Merge(
    Data1=digit_scroller_4,
    Data2=digit_scroller_5,
    Data3=digit_scroller_6,
    Data4=digit_scroller,
    Data5=digit_scroller_7,
    Data6=digit_scroller_2,
    Data7=digit_scroller_8,
    Data8=digit_scroller_9,
    Data9=digit_scroller_10,
    Data10=digit_scroller_3,
    Data11=digit_scroller_11)
digit_scroller_12 = DigitScroller(Scroller_Digits=12, Scroller_Prefix=" ", Scroller_Radix=11, Scroller_Value=16)
digit_scroller_13 = DigitScroller(Scroller_Digits=12, Scroller_Prefix="Digit Scroller", Scroller_Radix=1, Scroller_Value=0)
power = Power(A=2, B=digit_scroller_13)
digit_scroller_14 = DigitScroller(Scroller_Digits=12, Scroller_Prefix=" ", Scroller_Radix=1, Scroller_Value=1.25)
range = Range(Domain=Domain(0, 1), Steps=digit_scroller_12)  # -> reverse(Range)
expression = Expression(X=range, O=Slider(1.6, range=0..4), Expression="(1-ABS(X-1)^O)^(((1)/(O)))")
concatenate = Concatenate(FragmentA="[N-1]/", FragmentB=digit_scroller_14)

digit_scroller_15 = DigitScroller(Scroller_Digits=12, Scroller_Prefix=" ", Scroller_Radix=1, Scroller_Value=2.5)
expression_2 = Expression(X=range, O=digit_scroller_15, Expression="1-(1-ABS(X-0)^O)^(((1)/(O)))")
digit_scroller_16 = DigitScroller(Scroller_Digits=12, Scroller_Prefix=" ", Scroller_Radix=1, Scroller_Value=0.51)
expression_3 = Expression(X=range, O=digit_scroller_16, Expression="(1-ABS(X-1)^O)^(((1)/(O)))")
digit_scroller_17 = DigitScroller(Scroller_Digits=12, Scroller_Prefix=" ", Scroller_Radix=1, Scroller_Value=2)
digit_scroller_18 = DigitScroller(Scroller_Digits=12, Scroller_Prefix=" ", Scroller_Radix=1, Scroller_Value=0.538)
number_slider = Slider(1.531241, range=0..4)
number_slider_2 = Slider(0.475133, range=0..4)
quick_graph = QuickGraph(expression_3, SortOrder=0)

sequence = Sequence(Notation=concatenate, Length=expr("X+1", digit_scroller_12), Initial=power)
plane_surface = PlaneSurface(Plane=PlaneXY(0, 0, 1), XSize=Domain(-1, 1), YSize=Domain(-1, 1))
center = Center(Geometric=plane_surface, forall=True, referenceAll=0)  # -> Center, Dimension
graph_mapper = GraphMapper(range, x0=0, x1=1, y0=0, y1=1, Gx=0, Gy=0, Ox=1, Oy=1, container_name="Square Root")
rectangle = Rectangle(plane_surface)
digit_scroller_19 = DigitScroller(Scroller_Digits=12, Scroller_Prefix="Digit Scroller", Scroller_Radix=9, Scroller_Value=16)
construct_domain = ConstructDomain(DomainStart=expr("-X", sequence), DomainEnd=sequence)
rectangle_2 = Rectangle(Plane=PlaneXY(0, 0, 1), XSize=construct_domain, YSize=construct_domain, Radius=0)  # -> graft(Rectangle), Length
scale = Scale(Geometry=rectangle_2.Rectangle, Center=Point(0, 0, 0), Factor=expr("1/2^X", digit_scroller_13))  # -> Geometry, Transform
scale_2 = Scale(Geometry=scale.Geometry, Center=Point(0, 0, 0), Factor=expr("2^X", digit_scroller_13))  # -> Geometry, Transform; disabled
scale_3 = Scale(Geometry=scale.Geometry, Center=Point(0, 0, 0), Factor=expr("2^X", digit_scroller_19))  # -> Geometry, Transform
expression_4 = Expression(X=range, Expression="-cos(((x*PI)))/2+.5")

expression_5 = Expression(X=range, O=Slider(2.4, range=0..4), Expression="1-(1-ABS(X-0)^O)^(((1)/(O)))")
expression_6 = Expression(X=range, O=Slider(0.1, range=0..4), Expression="(1-ABS(X-1)^O)^(((1)/(O)))")

arc = Arc(Plane=PlaneXY(1, 0.5, 0), Radius=0.5, Angle=Domain(1.570796327, 3.141592654))  # -> Arc, Length
arc_2 = Arc(Plane=Plane(origin=(0, 0.5, 0), x=(-1, 0, 0), y=(0, -1, 0)), Radius=0.5, Angle=Domain(1.570796327, 3.141592654))  # -> Arc, Length
divide_curve = DivideCurve(Curve=scale_3.Geometry, Count=expr("X*4", digit_scroller_12), Kinks=False)  # -> Points, Tangents, Parameters

digit_scroller_20 = DigitScroller(Scroller_Digits=12, Scroller_Prefix=" ", Scroller_Radix=1, Scroller_Value=0.538)
expression_7 = Expression(X=range, O=Slider(2, range=0..4), Expression="(1-ABS(X-1)^O)^(((1)/(O)))")

digit_scroller_21 = DigitScroller(Scroller_Digits=12, Scroller_Prefix=" ", Scroller_Radix=1, Scroller_Value=0.718282)
digit_scroller_22 = DigitScroller(Scroller_Digits=12, Scroller_Prefix=" ", Scroller_Radix=1, Scroller_Value=0.538)
digit_scroller_23 = DigitScroller(Scroller_Digits=12, Scroller_Prefix=" ", Scroller_Radix=1, Scroller_Value=0.718282)
expression_8 = Expression(X=range, O=Slider(2, range=0..4), Expression="(1-ABS(X-1)^O)^(((1)/(O)))")
expression_9 = Expression(X=range, O=Slider(2, range=0..4), Expression="1-(1-ABS(X-0)^O)^(((1)/(O)))")

scale_4 = Scale(Geometry=divide_curve.Points, Center=Point(0, 0, 0), Factor=expr("1/2^X", digit_scroller_19))  # -> Geometry, Transform
join_curves = JoinCurves(Curves=[arc_2.Arc, arc.Arc], Preserve=False)
line_sdl = LineSDL(Start=Point(0, 0, 0), Direction=Vector(1, 1, 0), Length=1.414213562)
mirror = Mirror(Geometry=join_curves, Plane=Plane(origin=(0, 0, 0), x=(0, 0, 1), y=(0.7071067812, 0.7071067812, 0)))  # -> Geometry, Transform
expression_10 = Expression(X=range, Expression="-cos(((x*PI)))/2+.5")
expression_11 = Expression(X=range, Expression="asin(((x-.5)*2))/PI+.5")
flip_matrix = FlipMatrix(Data=scale_4.Geometry)
number_slider_3 = Slider(0.6, range=0..1)
panel = Panel(flip_matrix)
construct_point = ConstructPoint(XCoordinate=range, YCoordinate=expression_8, ZCoordinate=0)
quad_sphere = QuadSphere(Base=PlaneXY(0, 0, 0), Radius=1)
deconstruct_brep = DeconstructBrep(Brep=quad_sphere)  # -> Faces, Edges, Vertices
quick_graph_2 = QuickGraph(expression_8, SortOrder=0)
interpolate = Interpolate(Vertices=flip_matrix, Degree=3, Periodic=False, KnotStyle=1)  # -> Curve, Length, Domain
list_item = ListItem(List=deconstruct_brep.Faces, Index=0, Wrap=False)
construct_point_2 = ConstructPoint(XCoordinate=range, YCoordinate=expression_10, ZCoordinate=0)
digit_scroller_24 = DigitScroller(Scroller_Digits=12, Scroller_Prefix="Digit Scroller", Scroller_Radix=9, Scroller_Value=16)
point = Point(Point(0, 0, 0))
number_slider_4 = Slider(1, range=0..2)
interpolate_2 = Interpolate(Vertices=construct_point, Degree=3, Periodic=False, KnotStyle=1)  # -> Curve, Length, Domain
interpolate_3 = Interpolate(Vertices=construct_point_2, Degree=3, Periodic=False, KnotStyle=1)  # -> Curve, Length, Domain
scale_5 = Scale(Geometry=construct_point, Center=Point(0, 0, 0), Factor=0.5)  # -> reverse(Geometry), Transform
mirror_2 = Mirror(Geometry=scale_5.Geometry, Plane=Plane(origin=(0, 0, 0), x=(0, 0, 1), y=(0.7071067812, 0.7071067812, 0)))  # -> Geometry, Transform
move = Move(Geometry=mirror_2.Geometry, Motion=Vector(0.5, 0.5, 0))  # -> Geometry, Transform
scale_6 = Scale(Geometry=scale_5.Geometry, Center=Point(0, 0, 0), Factor=number_slider_4)  # -> Geometry, Transform
scale_7 = Scale(Geometry=move.Geometry, Center=Point(0, 0, 0), Factor=expr("2-X", number_slider_4))  # -> Geometry, Transform
list_item_2 = ListItem(List=reverse(scale_6.Geometry), Index=0, Wrap=False)
graph_mapper_2 = GraphMapper(range, x0=0, x1=1, y0=0, y1=1, container_name="Sigmoid-Logits", e=0.5210951567, t0=-100, t1=100)
list_item_3 = ListItem(List=scale_7.Geometry, Index=0, Wrap=False)
number = Number(1.525878906e-05)
expression_12 = Expression(X=range, Expression="asin(((x-.5)*2))/PI+.5")
extrude_point = ExtrudePoint(Base=interpolate.Curve, Point=point)  # disabled
dot_display = DotDisplay(Point=list_item_2, Colour=RGB(0, 0, 0), Size=0.0625)  # disabled
vector_2pt = Vector2Pt(PointA=list_item_3, PointB=list_item_2, Unitize=False)  # -> Vector, Length
move_2 = Move(Geometry=scale_7.Geometry, Motion=vector_2pt.Vector)  # -> Geometry, Transform
pull_curve = PullCurve(Curve=interpolate.Curve, Surface=list_item)
digit_scroller_25 = DigitScroller(Scroller_Digits=12, Scroller_Prefix="Digit Scroller", Scroller_Radix=9, Scroller_Value=0)
number_2 = Number(digit_scroller_12)
digit_scroller_26 = DigitScroller(Scroller_Digits=12, Scroller_Prefix="Digit Scroller", Scroller_Radix=11, Scroller_Value=288)
brep_brep = BrepBrep(BrepA=extrude_point, BrepB=list_item)  # -> Curves, Points
merge_2 = Merge(Data1=scale_6.Geometry, Data2=move_2.Geometry)
curve = Curve(pull_curve)
plane_surface_2 = PlaneSurface(Plane=PlaneXY(0, 0, 0), XSize=Domain(-1, 1), YSize=Domain(-1, 1))
digit_scroller_27 = DigitScroller(Scroller_Digits=12, Scroller_Prefix="Digit Scroller", Scroller_Radix=11, Scroller_Value=83)
cull_duplicates = CullDuplicates(Points=merge_2, Tolerance=0.00390625, CullMode=1)  # -> Points, Indices, Valence
interpolate_4 = Interpolate(Vertices=cull_duplicates.Points, Degree=3, Periodic=False, KnotStyle=1)  # -> Curve, Length, Domain
scale_8 = Scale(Geometry=interpolate_4.Curve, Center=Point(0, 0, 0), Factor=expr("2^X", digit_scroller_24))  # -> Geometry, Transform
end_points = EndPoints(Curve=scale_8.Geometry)  # -> Start, End
rectangle_2pt = Rectangle2Pt(Plane=PlaneXY(0, 0, 0), PointA=end_points.Start, PointB=end_points.End, Radius=0)  # -> Rectangle, Length
graphmapper = GraphMapper(Curve=scale_8.Geometry, Boundary=rectangle_2pt.Rectangle, Numbers=range, bobo=True)
digit_scroller_28 = DigitScroller(Scroller_Digits=12, Scroller_Prefix="Digit Scroller", Scroller_Radix=11, Scroller_Value=13)
center_box = CenterBox(Base=PlaneXY(1, 0, 0), X=1, Y=1, Z=1)  # disabled
mesh_box = MeshBox(Base=center_box, XCount=1, YCount=1, ZCount=1)  # disabled
plane_surface_3 = PlaneSurface(Plane=PlaneYZ(0, 0, 0), XSize=Domain(-10, 10), YSize=Domain(-10, 10))
mesh_plane = MeshPlane(Boundary=plane_surface_3, WidthCount=10, HeightCount=10)  # -> Mesh, Area; disabled

graphmapper_2 = GraphMapper(Curve=scale_8.Geometry, Boundary=rectangle_2pt.Rectangle, Numbers=range, bobo=True)

stream_filter = StreamFilter(Gate=Slider(0, range=0..1), Stream0=number, Stream1=graphmapper_2)

prude_curve = PrudeCurve(Curve=scale.Geometry, Length=graft(stream_filter), BlendType=1, Bulge=0.5)  # -> Prude, ResultBoolean
prude_curve_2 = PrudeCurve(Curve=scale.Geometry, Length=graft(stream_filter), BlendType=0, Bulge=Slider(0.4, range=0..1))  # -> Prude, ResultBoolean

pull_curve_2 = PullCurve(Curve=prude_curve.Prude, Surface=list_item)
curve_2 = Curve([interpolate.Curve, prude_curve.Prude])
curve_3 = Curve([pull_curve, pull_curve_2])
curve_4 = Curve(pull_curve_2)
curve_curve = CurveCurve(CurveA=flatten(curve), CurveB=curve_4)  # -> Points, ParamsA, ParamsB; disabled
curvature_graph = CurvatureGraph(Curve=pull_curve_2, Density=1, Scale=digit_scroller_27)  # disabled
curve_5 = Curve(curve_3)
scale_9 = Scale(Geometry=curve_5, Center=Point(0, 0, 0), Factor=expr("2^X", digit_scroller_25))  # -> Geometry, Transform
divide_curves_on_intersects = DivideCurvesOnIntersects(Curves=flatten(scale_9.Geometry), Tolerance=0)  # disabled
ggcurvessplitintersect = GgCurvesSplitIntersect(Curves=flatten(scale_9.Geometry), Tol=0, SplitPoly=False)  # -> flatten(Curves)
merge_3 = Merge(Data1=curve, Data2=curve_4)  # disabled
scale_10 = Scale(Geometry=ggcurvessplitintersect, Center=Point(0, 0, 0), Factor=expr("1/2^X", digit_scroller_25))  # -> Geometry, Transform
list_item_4 = ListItem(List=scale_10.Geometry, Index=digit_scroller_26, Wrap=False)
list_item_5 = ListItem(List=scale_10.Geometry, Index=expr("X+1", digit_scroller_26), Wrap=False)
project = Project(Curve=list_item_4, Brep=plane_surface_2, Direction=Vector(0, 0, 1))
project_2 = Project(Curve=list_item_5, Brep=plane_surface_2, Direction=Vector(0, 0, 1))
ggnetworkpolygons = GgNetworkPolygons(Curves=scale_10.Geometry, PerimOrVoid=4)
list_item_6 = ListItem(List=scale_10.Geometry, Index=digit_scroller_26, Wrap=False)  # -> Item, Item1, Item2, Item3, Item4, Item5, Item6, Item7
mirror_3 = Mirror(Geometry=ggnetworkpolygons, Plane=PlaneXY(0, 0, 0))  # -> Geometry, Transform
project_3 = Project(
    Curve=[list_item_6.Item, list_item_6.Item1, list_item_6.Item2, list_item_6.Item3, list_item_6.Item4, list_item_6.Item5, list_item_6.Item6, list_item_6.Item7],
    Brep=plane_surface_2,
    Direction=Vector(0, 0, 1))  # -> flatten(Curve)
length = Length(Curve=project)
length_2 = Length(Curve=project_2)
merge_4 = Merge(Data1=ggnetworkpolygons, Data2=mirror_3.Geometry)
length_3 = Length(Curve=project_3)
list_length = ListLength(List=length_3)
series = Series(Start=1, Step=1, Count=expr("X-1", list_length))
panel_2 = Panel(length)
panel_3 = Panel(length_2)
relative_differences = RelativeDifferences(Values=length_3)
division = Division(A=length_2, B=length)
panel_4 = Panel(division)
polar_array = PolarArray(
    Geometry=graft(merge_4),
    Plane=[Plane(origin=(0, 0, 0), x=(0, 0, 1), y=(1, 0, 0)), PlaneYZ(0, 0, 0)],
    Count=2,
    Angle=3.141592654)  # -> Geometry, Transform
discontinuity = Discontinuity(Curve=ggnetworkpolygons, Level=1)  # -> Points, Parameters
list_item_7 = ListItem(List=relative_differences, Index=series, Wrap=False)

quick_graph_3 = QuickGraph(length_3, SortOrder=0)
quick_graph_4 = QuickGraph(list_item_7, SortOrder=0)

quick_graph_5 = QuickGraph(length_3, SortOrder=0)
list_item_8 = ListItem(List=discontinuity.Points, Index=0, Wrap=False)  # -> Item, Item1, Item2, Item3, Item4
_4point_surface = _4PointSurface(CornerA=list_item_8.Item, CornerB=list_item_8.Item1, CornerC=list_item_8.Item2, CornerD=list_item_8.Item3)  # disabled
geometry = Geometry(polar_array.Geometry)
panel_6 = Panel(list_item_8.Item)
brep_join = BrepJoin(Breps=flatten(_4point_surface))  # -> Breps, Closed; disabled
merge_5 = Merge(Data1=list_item_8.Item, Data2=list_item_8.Item1, Data3=list_item_8.Item2, Data4=list_item_8.Item3)
brep_plane = BrepPlane(Brep=brep_join.Breps, Plane=plane_surface_3)  # -> Curves, Points; disabled
construct_mesh = ConstructMesh(Vertices=merge_5, Faces={A=0, B=1, C=2, D=3})  # -> flatten(Mesh)
mesh_join = MeshJoin(Meshes=flatten(construct_mesh))
mirror_cut_mesh = MirrorCutMesh(
    Mesh=mesh_join,
    MirrorPlane=plane_surface_3,
    Reach=0,
    Offset=0,
    Flip=False,
    Join=True,
    Keep=False,
    ConnectionType=1,
    Bulge=0,
    Divisions=1,
    WeldVertices=0.0009765625)  # -> MirrorCut, SplitIndex, ReachPlane, OffsetPlane, Intersected
mirror_4 = Mirror(Geometry=mirror_cut_mesh.MirrorCut, Plane=PlaneXY(0, 0, 0))  # -> Geometry, Transform
merge_6 = Merge(Data1=mirror_cut_mesh.MirrorCut, Data2=mirror_4.Geometry)
polar_array_2 = PolarArray(
    Geometry=graft(merge_6),
    Plane=[Plane(origin=(0, 0, 0), x=(0, 0, 1), y=(1, 0, 0)), PlaneYZ(0, 0, 0)],
    Count=2,
    Angle=3.141592654)  # -> Geometry, Transform
mesh_join_2 = MeshJoin(Meshes=flatten(mirror_cut_mesh.MirrorCut))  # disabled
mirror_cut_mesh_2 = MirrorCutMesh(
    Mesh=mirror_cut_mesh.MirrorCut,
    MirrorPlane=Plane(origin=(0, 0, 0), x=(0, 0, 1), y=(1, 0, 0)),
    Reach=0,
    Offset=0,
    Flip=False,
    Join=True,
    Keep=False,
    ConnectionType=1,
    Bulge=0,
    Divisions=1,
    WeldVertices=0.0009765625)  # -> MirrorCut, SplitIndex, ReachPlane, OffsetPlane, Intersected; disabled
geometry_2 = Geometry(polar_array_2.Geometry)
