# Grasshopper definition XHG.⠀ⵙ⠀ᗝ⠀ⵙ⠀ꖴ⠀ⵙ⠀Ⓞ⠀ⵙ⠀ᙏ⠀ⵙ⠀ᕤᕦ⠀ⵙ⠀ꖴ⠀ⵙ⠀ᔓᔕ⠀ⵙ⠀◯⠀ⵙ⠀ИN⠀ⵙ⠀Ⓞ⠀ⵙ⠀ꖴ⠀ⵙ⠀✤⠀ⵙ⠀ꖴ⠀ⵙ⠀ᔓᔕ⠀ⵙ⠀ИN⠀ⵙ⠀ᗩ⠀ⵙ⠀ᴥ⠀ⵙ⠀✤⠀ⵙ⠀◯⠀ⵙ⠀ᗱᗴ⠀ⵙ⠀ᕤᕦ⠀ⵙ⠀ᗝ⠀ⵙ⠀ᗱᗴ⠀ⵙ⠀◯⠀ⵙ⠀ᙁ⠀ⵙ⠀ᑎ⠀ⵙ⠀ꗳ⠀ⵙ⠀◯⠀ⵙ⠀◯⠀ⵙ⠀ꗳ⠀ⵙ⠀ᑎ⠀ⵙ⠀ᙁ⠀ⵙ⠀◯⠀ⵙ⠀ᗱᗴ⠀ⵙ⠀ᗝ⠀ⵙ⠀ᕤᕦ⠀ⵙ⠀ᗱᗴ⠀ⵙ⠀◯⠀ⵙ⠀✤⠀ⵙ⠀ᴥ⠀ⵙ⠀ᗩ⠀ⵙ⠀ИN⠀ⵙ⠀ᔓᔕ⠀ⵙ⠀ꖴ⠀ⵙ⠀✤⠀ⵙ⠀ꖴ⠀ⵙ⠀Ⓞ⠀ⵙ⠀ИN⠀ⵙ⠀◯⠀ⵙ⠀ᔓᔕ⠀ⵙ⠀ꖴ⠀ⵙ⠀ᕤᕦ⠀ⵙ⠀ᙏ⠀ⵙ⠀Ⓞ⠀ⵙ⠀ꖴ⠀ⵙ⠀ᗝ⠀ⵙ⠀.GHX (Grasshopper 1.0.7)
# plug-ins: Pufferfish, Heteroptera

curve = Curve(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)

curve_2 = Curve(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)

digit_scroller = DigitScroller(Scroller_Digits=12, Scroller_Prefix="Digit Scroller", Scroller_Radix=11, Scroller_Value=65536)  # disabled
construct_point = ConstructPoint(XCoordinate=0.5, YCoordinate=0.5, ZCoordinate=0)  # -> flatten(Point); disabled
line_sdl = LineSDL(Start=Point(0, 0, 0), Direction=Vector(1, 0, 0), Length=expr("X/2", 1))  # disabled
button = Button()  # disabled
file_path = FilePath("C:\IICSA.O____48361_EDIWID_1_TNEMERCNI____TNEIDARG_PUKOOL_ROLOC_DIOMGIS_ERUTAWRUC_RAENIL_NOITISNART_EGDE_LUF_EKUN____O____NUKE_FUL_EDGE_TRANSITION_LINEAR_CURWATURE_SIGMOID_COLOR_LOOKUP_GRADIENT____INCREMENT_1_DIWIDE_16384____O.ASCII")  # disabled
number = Number(digit_scroller)  # disabled

button_2 = Button()  # disabled
file_path_2 = FilePath("C:\VSC.O____STNEMGES_48361____DIOMGIS_ERUTAWRUC_RAENIL_NOITISNART_EGDE_LUF____O____FUL_EDGE_TRANSITION_LINEAR_CURWATURE_SIGMOID____16384_SEGMENTS____O.CSV")  # disabled

number_slider = Slider(0, range=0..1)  # disabled
button_3 = Button()  # disabled
file_path_3 = FilePath("C:\VSC.O____EPAHS_LANGIS____STNEMGES_48361____DIOMGIS_ERUTAWRUC_RAENIL_NOITISNART_EGDE_LUF____O____FUL_EDGE_TRANSITION_LINEAR_CURWATURE_SIGMOID____16384_SEGMENTS____SIGNAL_SHAPE____O.CSV")  # disabled

panel = Panel("0.0000053644183496292")  # disabled
panel_2 = Panel("""0    256    0.0013733120705119695
0    4096    0.0000053644183496292""")  # disabled

digit_scroller_2 = DigitScroller(Scroller_Digits=12, Scroller_Prefix="Digit Scroller", Scroller_Radix=1, Scroller_Value=3.3527e-07)  # disabled
number_slider_2 = Slider(4096, range=0..65536)  # disabled
radians = Radians(Degrees=panel)  # disabled

number_2 = Number(number_slider_2)  # disabled

series = Series(Start=0, Step=radians, Count=number_2)  # disabled
one_over_x = OneOverX(Value=number_2)  # disabled
duplicate_data = DuplicateData(Data=one_over_x, Number=number_2, Order=True)  # disabled
turtle = DotNETVBScriptLEGACY(Forward=duplicate_data, Left=series)  # -> Output, Points; inputs Forward: list, Left: list; disabled
# ---------- turtle: VB ----------
    Dim i As Integer
    Dim dir As New On3dVector(1, 0, 0)    
    Dim pos As New On3dVector(0, 0, 0) 
    Dim axis As New On3dVector(0, 0, 1)
    Dim pnts As New List(Of On3dVector)

    pnts.Add(pos)
    
    For i = 0 To Forward.Count() - 1
      Dim P As New On3dVector
      dir.Rotate(Left(i), axis)      
      P = dir * Forward(i) + pnts(i)
      pnts.Add(P)
    Next
    
    Points = pnts
# ---------- end turtle ----------
point = Point(turtle.Points)  # disabled

interpolate_t = InterpolateT(Vertices=point, TangentStart=Vector(0.0625, 0, 0), TangentEnd=Vector(0, 0, 0), KnotStyle=2)  # -> Curve, Length, Domain; disabled
evaluate_length = EvaluateLength(Curve=interpolate_t.Curve, Length=1, Normalized=True)  # -> Point, Tangent, Parameter; disabled
line_sdl_2 = LineSDL(Start=evaluate_length.Point, Direction=evaluate_length.Tangent, Length=1)  # disabled
mirror = Mirror(Geometry=interpolate_t.Curve, Plane=line_sdl_2)  # -> Geometry, Transform; disabled
join_curves = JoinCurves(Curves=[interpolate_t.Curve, mirror.Geometry], Preserve=False)  # disabled
evaluate_length_2 = EvaluateLength(Curve=join_curves, Length=1, Normalized=True)  # -> Point, Tangent, Parameter; disabled
rotate = Rotate(Geometry=join_curves, Angle=3.141592654, Plane=evaluate_length_2.Point)  # -> Geometry, Transform; disabled
join_curves_2 = JoinCurves(Curves=[join_curves, rotate.Geometry], Preserve=False)  # disabled
curve_3 = Curve(join_curves_2)  # disabled

expression = Expression(O=turtle.Points, Expression="FORMAT(\"{0:R}\",O)")  # disabled
panel_3 = Panel(expression)  # disabled
evaluate_length_3 = EvaluateLength(Curve=join_curves_2, Length=1, Normalized=True)  # -> Point, Tangent, Parameter; disabled
deconstruct = Deconstruct(Point=evaluate_length_3.Point)  # -> XComponent, YComponent, ZComponent; disabled
expression_2 = Expression(O=deconstruct.YComponent, Expression="FORMAT(\"{0:R}\",O)")  # disabled
expression_3 = Expression(O=deconstruct.XComponent, Expression="FORMAT(\"{0:R}\",O)")  # disabled
expression_4 = Expression(O=deconstruct.ZComponent, Expression="FORMAT(\"{0:R}\",O)")  # disabled
panel_4 = Panel(expression_2)  # disabled
panel_5 = Panel(expression_3)  # disabled
panel_6 = Panel(expression_4)  # disabled
addition = Addition(A=panel_4, B=panel_5)  # disabled
expression_5 = Expression(O=addition, Expression="FORMAT(\"{0:R}\",O)")  # disabled
panel_7 = Panel(expression_5)  # disabled
division = Division(A=panel_7, B=2)  # disabled
expression_6 = Expression(O=division, Expression="FORMAT(\"{0:R}\",O)")  # disabled
panel_8 = Panel(expression_6)  # disabled
scale = Scale(Geometry=curve_3, Center=Point(0, 0, 0), Factor=expr("1/X", panel_8))  # -> Geometry, Transform; disabled
evaluate_length_4 = EvaluateLength(Curve=scale.Geometry, Length=1, Normalized=True)  # -> Point, Tangent, Parameter; disabled
deconstruct_2 = Deconstruct(Point=evaluate_length_4.Point)  # -> XComponent, YComponent, ZComponent; disabled
expression_7 = Expression(O=deconstruct_2.YComponent, Expression="FORMAT(\"{0:R}\",O)")  # disabled
expression_8 = Expression(O=deconstruct_2.XComponent, Expression="FORMAT(\"{0:R}\",O)")  # disabled
expression_9 = Expression(O=deconstruct_2.ZComponent, Expression="FORMAT(\"{0:R}\",O)")  # disabled
panel_9 = Panel(expression_9)  # disabled
panel_10 = Panel(expression_7)  # disabled
panel_11 = Panel(expression_8)  # disabled
division_2 = Division(A=panel_5, B=panel_4)  # disabled
expression_10 = Expression(O=division_2, Expression="FORMAT(\"{0:R}\",O)")  # disabled
panel_12 = Panel(expression_10)  # disabled
curve_4 = Curve(scale.Geometry)  # disabled

number_3 = Number(expr("X*4", number_2))  # disabled
divide_curve = DivideCurve(Curve=line_sdl, Count=expr("X/2", number_3), Kinks=False)  # -> Points, Tangents, Parameters; disabled
line_sdl_3 = LineSDL(Start=divide_curve.Points, Direction=Vector(0, 1, 0), Length=1)  # disabled
scale_2 = Scale(Geometry=line_sdl_3, Center=Point(0, 0, 0), Factor=number)  # -> Geometry, Transform; disabled
curve_5 = Curve(curve_4)  # disabled
scale_3 = Scale(Geometry=curve_5, Center=Point(0, 0, 0), Factor=number)  # -> Geometry, Transform; disabled
curve_curve = CurveCurve(CurveA=scale_3.Geometry, CurveB=scale_2.Geometry)  # -> flatten(Points), ParamsA, ParamsB; disabled
scale_4 = Scale(Geometry=curve_curve.Points, Center=Point(0, 0, 0), Factor=expr("1/X", number))  # -> Geometry, Transform; disabled
deconstruct_3 = Deconstruct(Point=scale_4.Geometry)  # -> expr("ABS(X)", graft(XComponent)), expr("ABS(X)", graft(YComponent)), expr("ABS(X)", graft(ZComponent)); disabled
construct_point_2 = ConstructPoint(XCoordinate=deconstruct_3.XComponent, YCoordinate=deconstruct_3.YComponent, ZCoordinate=deconstruct_3.ZComponent)  # disabled
list_length = ListLength(List=scale_4.Geometry)  # disabled
panel_14 = Panel(list_length)  # disabled
construct_domain = ConstructDomain(DomainStart=0, DomainEnd=expr("X-2", panel_14))  # disabled
range = Range(Domain=construct_domain, Steps=expr("X-2", panel_14))  # disabled
list_item = ListItem(List=flatten(construct_point_2), Index=range, Wrap=False)  # -> flatten(Item); disabled
rotate_2 = Rotate(Geometry=list_item, Angle=3.141592654, Plane=construct_point)  # -> reverse(flatten(Geometry)), Transform; disabled
merge = Merge(Data1=list_item, Data2=construct_point, Data3=rotate_2.Geometry)  # disabled
deconstruct_4 = Deconstruct(Point=merge)  # -> graft(XComponent), graft(YComponent), ZComponent; disabled
expression_11 = Expression(O=deconstruct_4.XComponent, Expression="FORMAT(\"{0:0.00000000000000}\",O)")  # disabled
expression_12 = Expression(O=deconstruct_4.XComponent, Expression="FORMAT(\"{0:R}\",O)")  # disabled
data = Data(expression_12)  # disabled
panel_15 = Panel(data)  # disabled
expression_13 = Expression(O=deconstruct_4.YComponent, Expression="FORMAT(\"{0:0.00000000000000}\",O)")  # disabled
expression_14 = Expression(O=deconstruct_4.YComponent, Expression="FORMAT(\"{0:R}\",O)")  # disabled
data_2 = Data(expression_14)  # disabled
panel_16 = Panel(data_2)  # disabled
txtwriter = VBScript(filePath=file_path, data=flatten(panel_16), activate=button)  # -> out, A; inputs data: list; disabled
# ---------- txtwriter: VB ----------
    If activate Then

      Dim i As Integer
      Dim aryText(4) As String

      aryText(0) = "Mary WriteLine"
      aryText(1) = "Had"
      aryText(2) = "Another"
      aryText(3) = "Little"
      aryText(4) = "One"

      ' the data is appended to the file. If file doesnt exist, a new file is created
      Dim objWriter As New System.IO.StreamWriter(filePath, append)

      For i = 0 To data.Count - 1
        objWriter.WriteLine(data(i))
      Next

      objWriter.Close()

    End If

    If clearFile Then
      Dim objWriter As New System.IO.StreamWriter(filePath, False)
      objWriter.Close()
    End If
# ---------- end txtwriter ----------

number_4 = Number(expr("X*4", number_2))  # disabled
curve_6 = Curve(curve_4)  # disabled
divide_curve_2 = DivideCurve(Curve=curve_6, Count=number_4, Kinks=False)  # -> Points, Tangents, Parameters; disabled
deconstruct_5 = Deconstruct(Point=divide_curve_2.Points)  # -> graft(XComponent), graft(YComponent), ZComponent; disabled
expression_15 = Expression(Y=deconstruct_5.YComponent, Expression="FORMAT(\"{0:R}\",ROUND(Y, 15))")  # -> simplify(Result); disabled
expression_16 = Expression(X=deconstruct_5.XComponent, Expression="FORMAT(\"{0:R}\",ROUND(X, 15))")  # -> simplify(Result); disabled
expression_17 = Expression(X=deconstruct_5.XComponent, Expression="FORMAT(\"{0:R}\",X)")  # -> simplify(Result); disabled
panel_17 = Panel(expression_17)  # disabled
expression_18 = Expression(Y=deconstruct_5.YComponent, Expression="FORMAT(\"{0:R}\",Y)")  # -> simplify(Result); disabled
list_length_2 = ListLength(List=divide_curve_2.Points)  # disabled
duplicate_data_2 = DuplicateData(Data=";", Number=list_length_2, Order=True)  # -> simplify(graft(Data)); disabled
panel_18 = Panel(duplicate_data_2)  # disabled
panel_19 = Panel(expression_18)  # disabled
concatenate = Concatenate(FragmentA=panel_17, FragmentB=panel_18, FragmentA_2=panel_19)  # -> flatten(Result); disabled
panel_20 = Panel(concatenate)  # disabled
txtwriter_2 = VBScript(filePath=file_path_2, data=flatten(panel_20), activate=button_2)  # -> out, A; inputs data: list; disabled; same code as txtwriter

number_5 = Number(expr("X*4", number_2))  # disabled
curve_7 = Curve(curve_4)  # disabled
evaluate_length_5 = EvaluateLength(Curve=curve_7, Length=flatten(1), Normalized=True)  # -> Point, Tangent, Parameter; disabled
yz_plane = YZPlane(Origin=evaluate_length_5.Point)  # disabled
mirror_2 = Mirror(Geometry=curve_7, Plane=yz_plane)  # -> Geometry, Transform; disabled
join_curves_3 = JoinCurves(Curves=[curve_7, mirror_2.Geometry], Preserve=False)  # disabled
linear_array = LinearArray(Geometry=join_curves_3, Direction=Vector(2, 0, 0), Count=2)  # -> Geometry, Transform; disabled
join_curves_4 = JoinCurves(Curves=linear_array.Geometry, Preserve=False)  # disabled
flip_curve = FlipCurve(Curve=join_curves_4)  # -> Curve, Flag; disabled
stream_filter = StreamFilter(Gate=number_slider, Stream0=join_curves_4, Stream1=flip_curve.Curve)  # disabled
curve_domain = CurveDomain(Curve=stream_filter)  # -> Curve, Domain; disabled
deconstruct_domain = DeconstructDomain(Domain=curve_domain.Domain)  # -> Start, End; disabled
construct_domain_2 = ConstructDomain(DomainStart=expr("X/8", deconstruct_domain.End), DomainEnd=expr("X*5/8", deconstruct_domain.End))  # disabled
sub_curve = SubCurve(BaseCurve=curve_domain.Curve, Domain=construct_domain_2)  # disabled
move = Move(Geometry=sub_curve, Motion=Vector(-0.5, -0.5, 0))  # -> Geometry, Transform; disabled
scale_5 = Scale(Geometry=move.Geometry, Center=Point(0, 0, 0), Factor=0.5)  # -> Geometry, Transform; disabled
divide_curve_3 = DivideCurve(Curve=scale_5.Geometry, Count=number_5, Kinks=False)  # -> Points, Tangents, Parameters; disabled
deconstruct_6 = Deconstruct(Point=divide_curve_3.Points)  # -> simplify(graft(XComponent)), simplify(graft(YComponent)), ZComponent; disabled
expression_19 = Expression(X=deconstruct_6.XComponent, Expression="FORMAT(\"{0:R}\",X)")  # disabled
panel_21 = Panel(expression_19)  # disabled
expression_20 = Expression(Y=deconstruct_6.YComponent, Expression="FORMAT(\"{0:R}\",Y)")  # disabled
list_length_3 = ListLength(List=divide_curve_3.Points)  # disabled
duplicate_data_3 = DuplicateData(Data=";", Number=list_length_3, Order=True)  # -> simplify(graft(Data)); disabled
panel_22 = Panel(duplicate_data_3)  # disabled
panel_23 = Panel(expression_20)  # disabled
concatenate_2 = Concatenate(FragmentA=panel_21, FragmentB=panel_22, FragmentA_2=panel_23)  # -> flatten(Result); disabled
panel_24 = Panel(concatenate_2)  # disabled
txtwriter_3 = VBScript(filePath=file_path_3, data=flatten(panel_24), activate=button_3)  # -> out, A; inputs data: list; disabled; same code as txtwriter

create_material = CreateMaterial(Diffuse=RGB(235, 235, 235), Specular=RGB(0, 255, 255), Emission=RGB(0, 0, 0), Transparency=0.5, Shine=100)
create_material_2 = CreateMaterial(Diffuse=RGB(224, 224, 224), Specular=RGB(0, 255, 255), Emission=RGB(0, 0, 0), Transparency=0.5, Shine=100)
create_material_3 = CreateMaterial(Diffuse=RGB(242, 242, 242), Specular=RGB(0, 255, 255), Emission=RGB(0, 0, 0), Transparency=0.5, Shine=100)

panel_25 = Panel("""1    16    0.35721403168191375
1    256    0.0014014999884235925
1    4096    """)
digit_scroller_3 = DigitScroller(Scroller_Digits=12, Scroller_Prefix="Digit Scroller", Scroller_Radix=1, Scroller_Value=0.00140216731)
radians_2 = Radians(Degrees="0.0014014999884235925")

expression_21 = Expression(O=radians_2, Expression="FORMAT(\"{0:0.00000000000000000000}\",O)")
panel_26 = Panel(expression_21)
number_6 = Number(Slider(256, range=0..65536))

digit_scroller_4 = DigitScroller(Scroller_Digits=12, Scroller_Prefix=" ", Scroller_Radix=11, Scroller_Value=90)
create_material_4 = CreateMaterial(Diffuse=RGB(222, 222, 222), Specular=RGB(0, 255, 255), Emission=RGB(0, 0, 0), Transparency=0.5, Shine=100)
create_material_5 = CreateMaterial(Diffuse=RGB(232, 232, 232), Specular=RGB(0, 255, 255), Emission=RGB(0, 0, 0), Transparency=0.5, Shine=100)
create_material_6 = CreateMaterial(Diffuse=RGB(199, 199, 199), Specular=RGB(0, 255, 255), Emission=RGB(0, 0, 0), Transparency=0.5, Shine=100)
number_7 = Number(expr("X", 1024))
curve_8 = Curve(graft(curve_2))
divide_curve_4 = DivideCurve(Curve=curve_8, Count=number_7, Kinks=False)  # -> Points, Tangents, Parameters
curvature = Curvature(Curve=curve_8, Parameter=divide_curve_4.Parameters)  # -> Point, Curvature, Curvature_2
deconstruct_arc = DeconstructArc(Arc=curvature.Curvature_2)  # -> BasePlane, Radius, Angle
one_over_x_2 = OneOverX(Value=deconstruct_arc.Radius)
quick_graph = QuickGraph(one_over_x_2, SortOrder=0)
line = Line(StartPoint=curvature.Point, EndPoint=deconstruct_arc.BasePlane)
curvature_graph = CurvatureGraph(Curve=curve_8, Density=1, Scale=digit_scroller_4)
custom_preview = CustomPreview(Geometry=curve_8, Material=create_material_6)

expression_22 = Expression(O=deconstruct_arc.Radius, Expression="FORMAT(\"{0:R}\",O)")
panel_27 = Panel(expression_22)

expression_23 = Expression(O=one_over_x_2, Expression="FORMAT(\"{0:R}\",O)")
panel_28 = Panel(expression_23)

length = Length(Curve=curve_8)

polyline = PolyLine(Vertices=curvature.Point, Closed=False)
explode = Explode(Curve=polyline, Recursive=True)  # -> Segments, Vertices
curve_9 = Curve(flatten(explode.Segments))
length_2 = Length(Curve=curve_9)
sort_list = SortList(Keys=length_2, ValuesValuesA=curve_9)  # -> Keys, ValuesValuesA
panel_29 = Panel(sort_list.Keys)
list_item_2 = ListItem(List=sort_list.Keys, Index=0, Wrap=False)

derivatives = Derivatives(Curve=curve_8, Parameter=divide_curve_4.Parameters)  # -> Point, FirstDerivative, SecondDerivative, ThirdDerivative, FourthDerivative, FifthDerivative, SixthDerivative
relative_differences = RelativeDifferences(Values=one_over_x_2)
number_8 = Number(number_7)
quick_graph_2 = QuickGraph(relative_differences, SortOrder=0)
panel_30 = Panel(relative_differences)

bounds = Bounds(Numbers=relative_differences)
remap_numbers = RemapNumbers(Value=relative_differences, Source=bounds, Target=Domain(0, 1))  # -> Mapped, Clipped
multiplication = Multiplication(A=remap_numbers.Mapped, B=Slider(0.162613, range=0..1))

end_points = EndPoints(Curve=curve)  # -> Start, End
rectangle_2pt = Rectangle2Pt(Plane=PlaneXY(0, 0, 0), PointA=end_points.Start, PointB=end_points.End, Radius=0)  # -> Rectangle, Length

series_2 = Series(Start=0, Step=panel_26, Count=number_6)
expression_24 = Expression(O=series_2, Expression="FORMAT(\"{0:R}\",O)")
panel_31 = Panel(expression_24)
bounds_2 = Bounds(Numbers=panel_31)
one_over_x_3 = OneOverX(Value=number_6)
duplicate_data_4 = DuplicateData(Data=one_over_x_3, Number=number_6, Order=True)

curve_graph_mapper = CurveGraphMapper(Curves=curve, Rectangle=rectangle_2pt.Rectangle, Values=series_2, Flip=False, Snap=False, TextSize=0.015625)  # -> Mapped, GraphCurves, GraphPoints, ValueLines, ValuePoints, MappedLines, MappedPoints, Boundary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; disabled
graphmapper = GraphMapper(Curve=curve, Boundary=rectangle_2pt.Rectangle, Numbers=series_2, Input=bounds_2, Output=bounds_2, bobo=False)
stream_filter_2 = StreamFilter(Gate=Slider(1, range=0..1), Stream0=curve_graph_mapper.Mapped, Stream1=graphmapper)

turtle_2 = DotNETVBScriptLEGACY(Forward=duplicate_data_4, Left=stream_filter_2)  # -> Output, Points; inputs Forward: list, Left: list; same code as turtle
point_2 = Point(turtle_2.Points)

expression_25 = Expression(O=turtle_2.Points, Expression="FORMAT(\"{0:R}\",O)")
panel_32 = Panel(expression_25)

interpolate_t_2 = InterpolateT(Vertices=point_2, TangentStart=Vector(0.0625, 0, 0), TangentEnd=Vector(0, 0, 0), KnotStyle=2)  # -> Curve, Length, Domain
evaluate_length_6 = EvaluateLength(Curve=interpolate_t_2.Curve, Length=1, Normalized=True)  # -> Point, Tangent, Parameter
line_sdl_4 = LineSDL(Start=evaluate_length_6.Point, Direction=evaluate_length_6.Tangent, Length=1)
mirror_3 = Mirror(Geometry=interpolate_t_2.Curve, Plane=line_sdl_4)  # -> Geometry, Transform
join_curves_5 = JoinCurves(Curves=[interpolate_t_2.Curve, mirror_3.Geometry], Preserve=False)
evaluate_length_7 = EvaluateLength(Curve=join_curves_5, Length=1, Normalized=True)  # -> Point, Tangent, Parameter
rotate_3 = Rotate(Geometry=join_curves_5, Angle=3.141592654, Plane=evaluate_length_7.Point)  # -> Geometry, Transform
join_curves_6 = JoinCurves(Curves=[join_curves_5, rotate_3.Geometry], Preserve=False)
curve_10 = Curve(join_curves_6)

evaluate_length_8 = EvaluateLength(Curve=join_curves_6, Length=1, Normalized=True)  # -> Point, Tangent, Parameter
deconstruct_7 = Deconstruct(Point=evaluate_length_8.Point)  # -> XComponent, YComponent, ZComponent
expression_26 = Expression(O=deconstruct_7.YComponent, Expression="FORMAT(\"{0:R}\",O)")
expression_27 = Expression(O=deconstruct_7.XComponent, Expression="FORMAT(\"{0:R}\",O)")
expression_28 = Expression(O=deconstruct_7.ZComponent, Expression="FORMAT(\"{0:R}\",O)")
panel_33 = Panel(expression_26)
panel_34 = Panel(expression_27)
panel_35 = Panel(expression_28)
addition_2 = Addition(A=panel_33, B=panel_34)
expression_29 = Expression(O=addition_2, Expression="FORMAT(\"{0:R}\",O)")
panel_36 = Panel(expression_29)
division_3 = Division(A=panel_36, B=2)
expression_30 = Expression(O=division_3, Expression="FORMAT(\"{0:R}\",O)")
panel_37 = Panel(expression_30)
scale_6 = Scale(Geometry=point_2, Center=Point(0, 0, 0), Factor=expr("1/X", panel_37))  # -> Geometry, Transform
scale_7 = Scale(Geometry=curve_10, Center=Point(0, 0, 0), Factor=expr("1/X", panel_37))  # -> Geometry, Transform
evaluate_length_9 = EvaluateLength(Curve=scale_7.Geometry, Length=1, Normalized=True)  # -> Point, Tangent, Parameter
deconstruct_8 = Deconstruct(Point=evaluate_length_9.Point)  # -> XComponent, YComponent, ZComponent
expression_31 = Expression(O=deconstruct_8.YComponent, Expression="FORMAT(\"{0:R}\",O)")
expression_32 = Expression(O=deconstruct_8.XComponent, Expression="FORMAT(\"{0:R}\",O)")
expression_33 = Expression(O=deconstruct_8.ZComponent, Expression="FORMAT(\"{0:R}\",O)")
panel_38 = Panel(expression_31)
panel_39 = Panel(expression_32)
panel_40 = Panel(expression_33)
division_4 = Division(A=panel_34, B=panel_33)
expression_34 = Expression(O=division_4, Expression="FORMAT(\"{0:R}\",O)")
panel_41 = Panel(expression_34)

curve_11 = Curve(scale_7.Geometry)

point_3 = Point(scale_6.Geometry)

bounds_3 = Bounds(Numbers=one_over_x_2)
remap_numbers_2 = RemapNumbers(Value=one_over_x_2, Source=bounds_3, Target=Domain(0, 1))  # -> Mapped, Clipped

multiplication_2 = Multiplication(A=length, B=remap_numbers_2.Mapped)

multiplication_3 = Multiplication(A=multiplication_2, B=Slider(0.0625, range=0..2))

line_sdl_5 = LineSDL(Start=curvature.Point, Direction=line, Length=expr("-ABS(X)", multiplication_3))
evaluate_length_10 = EvaluateLength(Curve=line_sdl_5, Length=1, Normalized=True)  # -> Point, Tangent, Parameter
interpolate = Interpolate(Vertices=evaluate_length_10.Point, Degree=3, Periodic=False, KnotStyle=2)  # -> Curve, Length, Domain
custom_preview_2 = CustomPreview(Geometry=interpolate.Curve, Material=create_material_4)
custom_preview_3 = CustomPreview(Geometry=line_sdl_5, Material=create_material_5)

nurbs_curve = NurbsCurve(Vertices=evaluate_length_10.Point, Degree=3, Periodic=False)  # -> Curve, Length, Domain

curve_12 = Curve(interpolate.Curve)
line_sdl_6 = LineSDL(Start=evaluate_length_10.Point, Direction=line_sdl_5, Length=expr("ABS(X)", multiplication))
evaluate_length_11 = EvaluateLength(Curve=line_sdl_6, Length=1, Normalized=True)  # -> Point, Tangent, Parameter
line_sdl_7 = LineSDL(Start=evaluate_length_11.Point, Direction=derivatives.ThirdDerivative, Length=expr("-X", multiplication))
custom_preview_4 = CustomPreview(Geometry=line_sdl_7, Material=create_material)
interpolate_2 = Interpolate(Vertices=evaluate_length_11.Point, Degree=3, Periodic=False, KnotStyle=2)  # -> Curve, Length, Domain
custom_preview_5 = CustomPreview(Geometry=interpolate_2.Curve, Material=create_material_2)
custom_preview_6 = CustomPreview(Geometry=line_sdl_6, Material=create_material_3)

evaluate_length_12 = EvaluateLength(Curve=line_sdl_7, Length=1, Normalized=True)  # -> Point, Tangent, Parameter
interpolate_3 = Interpolate(Vertices=evaluate_length_12.Point, Degree=3, Periodic=False, KnotStyle=2)  # -> Curve, Length, Domain
nurbs_curve_2 = NurbsCurve(Vertices=evaluate_length_12.Point, Degree=11, Periodic=False)  # -> Curve, Length, Domain
nurbs_curve_3 = NurbsCurve(Vertices=evaluate_length_11.Point, Degree=11, Periodic=False)  # -> Curve, Length, Domain
merge_2 = Merge(Data1=evaluate_length_11.Point)
dot_display = DotDisplay(Point=merge_2, Colour=RGB(194, 194, 194), Size=expr("X/2", list_item_2))

number_slider_3 = Slider(0.0625, range=0..2)  # disabled
line_sdl_8 = LineSDL(Start=Point(0, 0, 0), Direction=Vector(1, 0, 0), Length=1)  # disabled

curve_13 = Curve(graft(curve_2))  # disabled
number_9 = Number(1024)  # disabled
divide_curve_5 = DivideCurve(Curve=curve_13, Count=number_9, Kinks=False)  # -> Points, Tangents, Parameters; disabled
curvature_2 = Curvature(Curve=curve_13, Parameter=divide_curve_5.Parameters)  # -> Point, Curvature, Curvature_2; disabled
deconstruct_arc_2 = DeconstructArc(Arc=curvature_2.Curvature_2)  # -> BasePlane, Radius, Angle; disabled
expression_35 = Expression(O=deconstruct_arc_2.Radius, Expression="FORMAT(\"{0:R}\",O)")  # disabled
panel_43 = Panel(expression_35)  # disabled
one_over_x_4 = OneOverX(Value=deconstruct_arc_2.Radius)  # disabled

expression_36 = Expression(O=one_over_x_4, Expression="FORMAT(\"{0:R}\",O)")  # disabled
panel_44 = Panel(expression_36)  # disabled

quick_graph_3 = QuickGraph(one_over_x_4, SortOrder=0)  # disabled
divide_curve_6 = DivideCurve(Curve=line_sdl_8, Count=number_9, Kinks=False)  # -> Points, Tangents, Parameters; disabled
multiplication_4 = Multiplication(A=one_over_x_4, B=number_slider_3)  # disabled
line_sdl_9 = LineSDL(Start=divide_curve_6.Points, Direction=Vector(0, 1, 0), Length=multiplication_4)  # disabled

curve_14 = Curve(line_sdl_9)  # disabled
