# Grasshopper definition XHꓨ. ⠀⠀ 𐄪 ⠀⠀ ◦︎𖧋◦︎◯◦︎𖧋◦︎⠀⠀  ⚪  ⠀⠀◦︎𖧋◦︎◯◦︎𖧋◦︎ ⠀⠀ 𐄪 ⠀⠀ .GHX (Grasshopper 1.0.7)
# plug-ins: Anemone, Pufferfish, GraphicPlus

rectangle = Rectangle(Plane=PlaneXY(0, 0, 0), XSize=Domain(-0.5, 0.5), YSize=Domain(-0.5, 0.5), Radius=0)  # -> Rectangle, Length
circle = Circle(Plane=PlaneXY(0, 0, 0), Radius=expr(".5/3", 0.5))
bounding_rectangle = BoundingRectangle(Geometry=circle, Plane=PlaneXY(0, 0, 0), Axis=0, Slide=0, Union=True)  # -> Bounding, DimensionX, DimensionY
circle_2 = Circle(Plane=PlaneXY(0, 0, 0), Radius=expr(".5", 0.5))
rebuild_curve = RebuildCurve(Curve=rectangle.Rectangle, Count=8, Degree=0, EndTangents=True)
curve_edit_points = CurveEditPoints(Curve=rebuild_curve, Knots=False)  # -> Points, Tangents, Parameters
cull_duplicates = CullDuplicates(Points=curve_edit_points.Points, Tolerance=7.629394531e-06, CullMode=1)  # -> Points, Indices, Valence
point = Point(Point(0, 0, 0))
merge = Merge(Data1=point, Data2=cull_duplicates.Points)  # -> flatten(Result)
scale = Scale(Geometry=flatten(circle), Center=Point(0, 0, 0), Factor=expr("2^16", 1))  # -> Geometry, Transform
scale_2 = Scale(Geometry=flatten(cull_duplicates.Points), Center=Point(0, 0, 0), Factor=expr("2^16", 1))  # -> flatten(Geometry), Transform
boundary_surfaces = BoundarySurfaces(Edges=scale.Geometry)
digit_scroller = DigitScroller(Scroller_Digits=12, Scroller_Prefix=" ", Scroller_Radix=11, Scroller_Value=3)
fast_loop_start = FastLoopStart(Iterations=expr("X-1", digit_scroller), Data=boundary_surfaces)  # -> port, Counter, Data
scale_3 = Scale(Geometry=flatten(merge), Center=Point(0, 0, 0), Factor=expr("2^16", 1))  # -> flatten(Geometry), Transform
fast_loop_start_2 = FastLoopStart(Iterations=expr("X-1", digit_scroller), Data=scale.Geometry)  # -> port, Counter, Data
fast_loop_start_3 = FastLoopStart(Iterations=digit_scroller, Data=scale.Geometry)  # -> port, Counter, Data
scale_4 = Scale(Geometry=graft(fast_loop_start.Data), Center=scale_2.Geometry, Factor=0.3333333333)  # -> Geometry, Transform
scale_5 = Scale(Geometry=graft(fast_loop_start_2.Data), Center=scale_2.Geometry, Factor=0.3333333333)  # -> Geometry, Transform
scale_6 = Scale(Geometry=graft(fast_loop_start_3.Data), Center=scale_3.Geometry, Factor=0.3333333333)  # -> Geometry, Transform
fast_loop_end = FastLoopEnd(port=fast_loop_start_2.port, Exit=False, Data=scale_5.Geometry, RecordData=True, TimeOutVal=0)
fast_loop_end_2 = FastLoopEnd(port=fast_loop_start.port, Exit=False, Data=scale_4.Geometry, RecordData=True, TimeOutVal=0)
merge_2 = Merge(Data1=boundary_surfaces, Data2=fast_loop_end_2)  # -> flatten(Result)
scale_7 = Scale(Geometry=flatten(merge_2), Center=Point(0, 0, 0), Factor=expr("1/2^16", 1))  # -> Geometry, Transform; disabled
fast_loop_end_3 = FastLoopEnd(port=fast_loop_start_3.port, Exit=False, Data=scale_6.Geometry, RecordData=True, TimeOutVal=0)  # -> flatten(Data)
merge_3 = Merge(Data1=scale.Geometry, Data2=fast_loop_end)  # -> flatten(Result)
collision_one_many = CollisionOneMany(Collider=flatten(fast_loop_end_3), Obstacles=flatten(merge_2))  # -> Collision, Index
scale_8 = Scale(Geometry=flatten(merge_3), Center=Point(0, 0, 0), Factor=expr("1/2^16", 1))  # -> Geometry, Transform
cull_pattern = CullPattern(List=flatten(fast_loop_end_3), CullPattern=invert(flatten(collision_one_many.Collision)))
scale_9 = Scale(Geometry=flatten(cull_pattern), Center=Point(0, 0, 0), Factor=expr("1/2^16", 1))  # -> Geometry, Transform
merge_4 = Merge(Data1=scale_8.Geometry, Data2=scale_9.Geometry)  # -> flatten(Result)
stroke = Stroke(ShapeGeometry=flatten(merge_4), Color=RGBA(0, 0, 0, 0), Weight=0, EndCap=2)
solid_fill = SolidFill(ShapeGeometry=flatten(stroke), Color=RGB(0, 244, 124))  # disabled
gradient_radial_fill = GradientRadialFill(ShapeGeometry=flatten(stroke), Colors=[RGB(0, 244, 124), RGBA(255, 255, 255, 0)], Parameters=[0, 1])
shape_preview_beta = ShapePreviewBeta(DrawingsShapesGeometry=solid_fill)  # disabled
shape_data = ShapeData(ShapeGeometry=gradient_radial_fill, ID=" ", Hover=False)
construct_drawing = ConstructDrawing(ShapesGeometry=flatten(shape_data), Boundary=rectangle.Rectangle, Width=729, Height=729, Color=RGBA(255, 255, 255, 0))  # -> Drawing, Boundary
save_svg = SaveSvg(DrawingsShapesGeometry=construct_drawing.Drawing, FolderPath="C:\", FileName="ϱvƨ", Save=Button())
drawing_viewer = DrawingViewer(DrawingsShapesGeometry=construct_drawing.Drawing, Resolution=96)
